# Dynamo graph FILIN_РасчетИнсоляции_АдаптивноеСемействоОкна.dyn (Dynamo 2.6.1.8786)
# packages: Data-Shapes 2021.2.94

# group: ProjectNorth VECTOR Z = 0 X--NORTH Y--WEST/EAST
surveyPoint = Coordinates.SurveyPoint()
X = Point.X(point=surveyPoint)
Y = Point.Y(point=surveyPoint)
Z = CodeBlock { 0; }
byCoordinates = Point.ByCoordinates(x=X, y=Y, z=Z)
x = CodeBlock { 0; }
Y_2 = CodeBlock { 1; }
byCoordinates_2 = Vector.ByCoordinates(x=x, y=Y_2, z=Z)

# group: True North Vector
ZAxis = Vector.ZAxis()
projectRotation = Coordinates.ProjectRotation()
rotate = Vector.Rotate(vector=byCoordinates_2, axis=ZAxis, degrees=projectRotation)

# group: True North Vector visualise
number_slider = DoubleSlider(1000, range=5..10000 step 1)  # frozen
code_block = CodeBlock(a=number_slider) { a*1000; }
byStartPointDirectionLength = Line.ByStartPointDirectionLength(startPoint=byCoordinates, direction=rotate, length=code_block)

# group: ProjectNorth VECTOR visualise
number_slider_2 = DoubleSlider(50, range=5..10000 step 1)  # frozen
code_block_2 = CodeBlock(a=number_slider_2) { a*1000; }
byStartPointDirectionLength_2 = Line.ByStartPointDirectionLength(startPoint=byCoordinates, direction=byCoordinates_2, length=code_block_2)

# group: ClockWork Rotation From TrueNorth to ProjectNorth
angleWithVector = Vector.AngleWithVector(vector=byCoordinates_2, otherVector=rotate)  # frozen

# group: Get Center
выбрать_окно = DSModelElementSelection()  # 1 picked in the model; graph input
getChildElements = Element.GetChildElements(element=выбрать_окно)
string_from_object = FromObject(obj=getChildElements)
string = StringInput("ЦентрИнсоляции_Тех")
code_block_3 = CodeBlock(a=string_from_object, b=string) { a==b; }
filterByBoolMask = List.FilterByBoolMask(list=getChildElements, mask=code_block_3)
getLocation = Element.GetLocation(element=filterByBoolMask.in)
code_block_4 = CodeBlock { 0; }
getItemAtIndex = List.GetItemAtIndex(list=getLocation, index=code_block_4)
element_to_instance = Python(IN[0]=выбрать_окно)
# ---------- element_to_instance.python (29 lines) ----------
# -*- coding: utf-8 -*-

import clr

# Revit API
clr.AddReference('RevitAPI')
clr.AddReference('RevitServices')
from Autodesk.Revit.DB import *
from RevitServices.Persistence import DocumentManager
from RevitServices.Transactions import TransactionManager

doc = DocumentManager.Instance.CurrentDBDocument

# IN[0] – Element(s) from Dynamo (can be from "Select Model Elements" or "Select Model Element")
elements = UnwrapElement(IN[0])

if not isinstance(elements, list):
    elements = [elements]

family_instances = []

for el in elements:
    if isinstance(el, FamilyInstance):
        family_instances.append(el)
    else:
        family_instances.append(None)  # Not a family instance

# Output
OUT = family_instances
# ----------------------------------------

# group: Set Start and End time
год = DoubleSlider(2020, range=2020..5000 step 1)  # graph input
месяц = DoubleSlider(4, range=1..12 step 1)  # graph input
день = DoubleSlider(22, range=1..31 step 1)  # graph input
начало_расчета_час = DoubleSlider(6, range=0..24 step 1)  # graph input
начало_расчета_минута = DoubleSlider(0, range=0..60 step 1)  # graph input
конец_расчета_час = DoubleSlider(18, range=0..24 step 1)  # graph input
конец_расчета_минута = DoubleSlider(0, range=0..60 step 1)  # graph input

# group: Set Timezone
часовой_пояс_utc = DoubleSlider(3, range=0..60 step 1)  # graph input

# group: Set calculation time period
расчетный_шаг_минута = DoubleSlider(20, range=0..60 step 1)  # graph input

# group: Set +-: North + South - East + West-
широта_n_северная_s_южная = StringInput("n")  # graph input
долгота_w_восточная_e_западная = StringInput("w")  # graph input

calculateSunPosition = Custom[CalculateSunPosition](Year=год, Month=месяц, Day=день, Start_Hour=начало_расчета_час, Start_Minute=начало_расчета_минута, End_Hour=конец_расчета_час, End_Minute=конец_расчета_минута, UTC=часовой_пояс_utc, TimeStep=расчетный_шаг_минута, North_South=широта_n_северная_s_южная, East_West=долгота_w_восточная_e_западная)  # Calculates sun posion for time perod on chosen date. Uses NOAA SPA method with error ≈ 1°. North_South: use "n-north, s-south" East_West: use"w-west, e-east"

# group: Altitude rotation
XAxis = Vector.XAxis()
rotate_2 = Vector.Rotate(vector=rotate, axis=XAxis, degrees=calculateSunPosition.Altitudes)

code_block_5 = CodeBlock(a=calculateSunPosition.Azimuts) { -a; }

# group: Azimuth rotation
ZAxis_2 = Vector.ZAxis()
rotate_3 = Vector.Rotate(vector=rotate_2, axis=ZAxis_2, degrees=code_block_5)

# group: SUN ALL RAY vectors visualise
длина_луча_м_визуализация = DoubleSlider(500, range=5..10000 step 1)  # graph input
code_block_6 = CodeBlock(a=длина_луча_м_визуализация) { a*1000; }
byStartPointDirectionLength_3 = Line.ByStartPointDirectionLength(startPoint=getItemAtIndex, direction=rotate_3, length=code_block_6)

# group: Get Ray Bounce, drop rays that bounce.
n3d_вид_для_анализа = Views("АНАЛИЗ_Исноляция_3D")  # "3D вид для анализа"; graph input
boolean = BoolSelector(false)
raybounce_on_linked_model = Custom[RayBounce On Linked Model](Points=getItemAtIndex, Direction=rotate_3, ThreeDView=n3d_вид_для_анализа, BounceOnLinkOnly=boolean)  # package Data-Shapes; Same functionality as raybounce but takes linked model elements into account
isNull = Object.IsNull(obj=raybounce_on_linked_model.Elements)
flatten = List.Flatten(list=isNull)

# group: Get rays TIME
filterByBoolMask_2 = List.FilterByBoolMask(list=calculateSunPosition.Time, mask=flatten)

# group: Get rays VECTOR
filterByBoolMask_3 = List.FilterByBoolMask(list=rotate_3, mask=flatten)
flatten_2 = List.Flatten(list=filterByBoolMask_3.in)

# group: Recognize PERIODS of time list
string_from_object_2 = FromObject(obj=filterByBoolMask_2.in)
string_2 = StringInput(" ")
split = String.Split(str=string_from_object_2, separator0=string_2)
lastItem = List.LastItem(list=split@L2)
python_script = Python(IN[0]=lastItem, IN[1]=расчетный_шаг_минута)
# ---------- python_script.python (54 lines) ----------
from datetime import datetime, timedelta

# Входы из Dynamo
times_str = IN[0]          # список строк формата "HH:MM:SS"
step_minutes = IN[1]        # шаг в минутах (число)

# Конвертируем строки в datetime
times = [datetime.strptime(t, "%H:%M:%S") for t in times_str]

# Удаляем подряд идущие дубликаты времени
def remove_consecutive_duplicates(dt_list):
    if not dt_list:
        return dt_list
    out = [dt_list[0]]
    for t in dt_list[1:]:
        if t != out[-1]:
            out.append(t)
    return out

times = remove_consecutive_duplicates(times)

periods = []
if times:
    start_time = times[0]
    prev_time = times[0]
    start_idx = 0  # индекс начала периода

    for idx, current in enumerate(times[1:], start=1):
        delta = current - prev_time

        # Игнорируем дубликаты (хоть и они уже удалены, на всякий случай)
        if delta == timedelta(0):
            continue

        if delta == timedelta(minutes=step_minutes):
            prev_time = current
        else:
            # Только если период действительно длился
            if prev_time != start_time:
                ray_indxs = list(range(start_idx, idx))
                duration = int((prev_time - start_time).total_seconds() / 60) + step_minutes
                periods.append((start_time.time(), prev_time.time(), duration, ray_indxs))
            start_time = current
            prev_time = current
            start_idx = idx

    # последний период
    ray_indxs = list(range(start_idx, len(times)))
    if prev_time != start_time:
        duration = int((prev_time - start_time).total_seconds() / 60) + step_minutes
        periods.append((start_time.time(), prev_time.time(), duration, ray_indxs))

# Вывод
OUT = periods
# ----------------------------------------
lastItem_2 = List.LastItem(list=python_script@L3)
getItemAtIndex_2 = List.GetItemAtIndex(list=flatten_2, index=lastItem_2)

# group: Calculate All insolation Time in minutes
string_3 = StringInput("FILI_ОбщееВремяИнсоляции_Точка")
code_block_7 = CodeBlock { 2; }
getItemAtIndex_3 = List.GetItemAtIndex(list=python_script@L3, index=code_block_7)
python_script_2 = Python(IN[0]=getItemAtIndex_3)
# ---------- python_script_2.python (2 lines) ----------
Data=IN[0]
OUT=(sum(Data))
# ----------------------------------------
setParameterByName = Element.SetParameterByName(element=выбрать_окно, parameterName=string_3, value=python_script_2)

# group: SUN RAY vector visualise for Segment Family on plan view
длина_визуализации_сегмента_на = DoubleSlider(100, range=2..10000 step 1)  # "Длина визуализации сегмента на Плане (м)"
code_block_8 = CodeBlock(a=длина_визуализации_сегмента_на) { a*1000; }
byStartPointDirectionLength_4 = Line.ByStartPointDirectionLength(startPoint=getItemAtIndex, direction=getItemAtIndex_2, length=code_block_8)

first_and_last_vectors_with = Python(IN[0]=byStartPointDirectionLength_4)  # "First and last vectors with ierarchie"
# ---------- first_and_last_vectors_with.python (9 lines) ----------
# IN[0] — ваш список из кортежей/списков
data = IN[0]

# для каждого элемента берем первый и последний элементы
OUT = [ (t[0], t[-1]) if isinstance(t, (list, tuple)) and len(t) >= 2 else None for t in data ]

# Пример:
# input  -> [(a, b), (a, b, c, d), (a, b, c)]
# output -> [(a, b), (a, d), (a, c)]
# ----------------------------------------

# group: Place Instances to star point
семейство_уго_сегмента_инсоляции = FamilyTypes("FILI_ИнсоляционныйСегмент_R21(ОбМод):ИнсоляцонныйСегмент")  # graph input
count = List.Count(list=first_and_last_vectors_with)
ofRepeatedItem = List.OfRepeatedItem(item=getItemAtIndex, amount=count)
byPoint = FamilyInstance.ByPoint(familyType=семейство_уго_сегмента_инсоляции, point=ofRepeatedItem)

# group: Pull Countor lines on generated Plane
ZAxis_3 = Vector.ZAxis()
byOriginNormal = Plane.ByOriginNormal(origin=getItemAtIndex, normal=ZAxis_3)
pullOntoPlane = Curve.PullOntoPlane(curve=first_and_last_vectors_with, plane=byOriginNormal)

# group: Pulled curves to line to vectors.
startPoint = Curve.StartPoint(curve=pullOntoPlane)
endPoint = Curve.EndPoint(curve=pullOntoPlane)
byStartPointEndPoint = Line.ByStartPointEndPoint(startPoint=startPoint, endPoint=endPoint)
direction = Line.Direction(line=byStartPointEndPoint)

# group: Vectors to angle between
firstItem = List.FirstItem(list=direction@L2)
lastItem_3 = List.LastItem(list=direction@L2)
angleWithVector_2 = Vector.AngleWithVector(vector=firstItem, otherVector=lastItem_3)

# group: Rotate from project North
angleWithVector_3 = Vector.AngleWithVector(vector=byCoordinates_2, otherVector=firstItem)
code_block_9 = CodeBlock(a=angleWithVector_3, b=angleWithVector_2) { a+b/2; }
setRotation = FamilyInstance.SetRotation(familyInstance=byPoint, degree=code_block_9)
intstance_ID = Python(IN[0]=setRotation)
# ---------- intstance_ID.python (15 lines) ----------
# IN[0] — список FamilyInstance (или одиночный элемент)
elems = IN[0]
if not isinstance(elems, (list, tuple)):
    elems = [elems]

ids = []
for e in elems:
    # Разгибаем Dynamo wrapper до реального элемента, если нужно
    obj = getattr(e, 'InternalElement', e)
    if hasattr(obj, 'Id') and hasattr(obj.Id, 'IntegerValue'):
        ids.append(obj.Id.IntegerValue)
    else:
        ids.append(None)

OUT = ids
# ----------------------------------------
element_by_id = ElementById(Id=intstance_ID)

# group: <Set Segment Lenght
string_4 = StringInput("SegmentLenght")
длина_визуализации_сегмента_на_2 = DoubleSlider(100, range=2..10000 step 1)  # "Длина визуализации сегмента на Плане (м)"; graph input
code_block_10 = CodeBlock(a=длина_визуализации_сегмента_на_2) { a*1000; }
setParameterByName_2 = Element.SetParameterByName(element=element_by_id, parameterName=string_4, value=code_block_10)

# group: Segment Angle
string_5 = StringInput("SegmentAngle")
setParameterByName_3 = Element.SetParameterByName(element=element_by_id, parameterName=string_5, value=angleWithVector_2)

# group: Set Time to segment>
string_6 = StringInput("FILI_ВремяИнсоляции_Сегмент")
setParameterByName_4 = Element.SetParameterByName(element=element_by_id, parameterName=string_6, value=getItemAtIndex_3)

# group: Calculate All insolation Time in minutes
string_7 = StringInput("FILI_ОбщееВремяИнсоляции_Точка")
code_block_11 = CodeBlock { 2; }
getItemAtIndex_4 = List.GetItemAtIndex(list=python_script@L3, index=code_block_11)
python_script_3 = Python(IN[0]=getItemAtIndex_4)  # same code as python_script_2
setParameterByName_5 = Element.SetParameterByName(element=выбрать_окно, parameterName=string_7, value=python_script_3)

# group: Time periods as string HH:mm-HH:mm;HH:mm-HH:mm
string_8 = StringInput("; ")
python_script_4 = Python(IN[0]=lastItem, IN[1]=расчетный_шаг_минута)
# ---------- python_script_4.python (50 lines) ----------
from datetime import datetime, timedelta

# Входы из Dynamo
times_str = IN[0]          # список строк формата "HH:MM:SS"
step_minutes = IN[1]        # шаг в минутах (число)

# Конвертируем строки в datetime
times = [datetime.strptime(t, "%H:%M:%S") for t in times_str]

# Удаляем подряд идущие дубликаты времени
def remove_consecutive_duplicates(dt_list):
    if not dt_list:
        return dt_list
    out = [dt_list[0]]
    for t in dt_list[1:]:
        if t != out[-1]:
            out.append(t)
    return out

times = remove_consecutive_duplicates(times)

periods = []
if times:
    start_time = times[0]
    prev_time = times[0]
    start_idx = 0  # индекс начала периода

    for idx, current in enumerate(times[1:], start=1):
        delta = current - prev_time

        # Игнорируем дубликаты (хоть и они уже удалены, на всякий случай)
        if delta == timedelta(0):
            continue

        if delta == timedelta(minutes=step_minutes):
            prev_time = current
        else:
            # Только если период действительно длился
            if prev_time != start_time:
                periods.append((start_time.time(), prev_time.time()))
            start_time = current
            prev_time = current
            start_idx = idx

    # последний период
    if prev_time != start_time:
        periods.append((start_time.time(), prev_time.time()))

# Вывод
OUT = periods
# ----------------------------------------
string_from_object_3 = FromObject(obj=python_script_4)
code_block_12 = CodeBlock { 0; }
getItemAtIndex_5 = List.GetItemAtIndex(list=string_from_object_3@L2, index=code_block_12)
code_block_13 = CodeBlock { 1; }
getItemAtIndex_6 = List.GetItemAtIndex(list=string_from_object_3@L2, index=code_block_13)
code_block_14 = CodeBlock(a=getItemAtIndex_5, b=getItemAtIndex_6) { a+"-"+b; }
join = String.Join(separator=string_8, string0=code_block_14)

# group: Calculate All insolation Time in minutes
string_9 = StringInput("FILI_ПериодИнсоляции")
setParameterByName_6 = Element.SetParameterByName(element=выбрать_окно, parameterName=string_9, value=join)

# group: Set Time period to segment>
string_10 = StringInput("FILI_ПериодИнсоляции")
setParameterByName_7 = Element.SetParameterByName(element=element_by_id, parameterName=string_10, value=code_block_14)
